% Simulink data dictionary topLevel.sldd
% references commands.sldd
% references Controller.sldd

ControlBus = Simulink.Bus()
  Roll: double
  Pitch: double
  Yaw: double
  Thrust: double[3 1]

EnvironmentBus = Simulink.Bus()
  Gravity: double

StateBus = Simulink.Bus()
  WorldPosition: double[3 1]
  WorldVelocity: double[3 1]
  Thrust: double[3 1]